vi "Rx Multiple Synchronized Inputs.gvi"   [LabVIEW Communications System Design Software 2.0.1]
panel controls:
  "IQ rate [S/sec]": f64 = 1000000
  "Carrier Frequency [Hz]": f64 = 2000000000
  "Gain 0": f64 = 10
  "Active Antenna 0": string = "RX1"
  "Gain 1": f64 = 10
  "Active Antenna 1": string = "RX1"
  "Start Trigger Time": T1 = {"whole seconds"=0, "fractional seconds"=0.1}
  "Number of Samples Per Fetch": i64 = 16384
  "Timeout": f64 = 10
  "Stop": bool
  "Device IDs": "niUSRPClass" = "192.168.10.2; 192.168.10.3"
  "Get": bool
  "Sync": bool
panel indicators:
  "Actual Rx Timestamp": T1
  "Baseband Power Spectrum": T2[]
  "IQ Graph": f64[][]
  "Polar Graph": c128[]
  "Graph": f64[]
  "Sync'd Signal": f64[][]
  "Phase Offset": c128
types:
  T1 = cluster{"whole seconds": u64, "fractional seconds": f64}
  T2 = cluster{"f0": f64, "df": f64, "magnitude": f64[]}
uses:
  NI::Analysis::Measurement::Power Spectrum for 1 Chan (CDB).gvi
  NI::Analysis::Statistics::Mean (CDB).gvi
diagram:
  call "niUSRP Open Rx Session.gvi"(device names=$"Device IDs", reset=TRUE) -> (error out=w1, session handle out=w2)
  Property Node(instance in=w2, "Enabled Channels"="0,1", error in=w1) -> (error out=w3, instance out=w4)
  # Synchronized devices must use a Start Trigger.
  call "niUSRP Configure Time Start Trigger.gvi"(session handle=w4, start trigger time=$"Start Trigger Time", error in=w3) -> (session handle out=w5, error out=w6)
  # Set the attributes common to all channels.
  Property Node(instance in=w5, "IQ Rate"=$"IQ rate [S/sec]", "Carrier Frequency"=$"Carrier Frequency [Hz]", error in=w6) -> ("IQ Rate"=w7, error out=w8, instance out=w9)
  # coerced IQ rate
  # sample period
  Reciprocal(x=w7) -> w10
  # Set the attributes specific to channel 0.
  Property Node(instance in=w9, sub-item="0", "Gain"=$"Gain 0", "Active Antenna"=$"Active Antenna 0", error in=w8) -> (error out=w11, instance out=w12)
  w13 = "Mimo"  # Reference Frequency Source
  w14 = "Mimo"  # Timebase Clock Source
  # Set the attributes specific to channel 1.
  # Channel 1 must also use the same
  # reference frequency and timebase clock
  # as channel 1 (in this case synchronized
  # over the MIMO cable).
  Property Node(instance in=w12, sub-item="1", "Gain"=$"Gain 1", "Active Antenna"=$"Active Antenna 1", "Reference Frequency Source"=w13, "Timebase Clock Source"=w14, error in=w11) -> (error out=w15, instance out=w16)
  call "niUSRP Set Time.gvi"(session handle=w16, apply timestamp="Now", timestamp=T1 {all zero or empty}, error in=w15, channel list="0,1") -> (session handle out=w17, error out=w18)
  # Set the internal
  # clocks back to
  # time 0.
  call "niUSRP Initiate.gvi"(session handle=w17, error in=w18) -> (session handle out=w19, error out=w20)
  s1 = w20  # shift register
  while (iteration -> i1) {
    call "niUSRP Fetch Rx Data (2D CDB).gvi"(session handle=w19, number of samples=$"Number of Samples Per Fetch", timeout=$Timeout, error in=s1) -> (session handle out=w21, data=w22, timestamp=w23, error out=w24)
    s2 = f64[][] []  # shift register
    for {
      w25 = each element of w22
      Complex To Real Imaginary(x + iy=w25) -> (x=w26, y=w27)
      Build Array[ConcatenateInputs=True](s2, w26, w27) -> w28
      next s2 = w28
    }
    $"IQ Graph" <- s2
    Quotient And Remainder(x=i1, y=8) -> (x-y*floor(x/y)=w29)
    case (w29) {
      frame Default { }
      frame 0 {
        for {
          w30 = each element of w22
          Property Node(instance in=waveform<c128> {all zero or empty}, "Y"=w30, "dt"=w10) -> (instance out=w32)
          call "Power Spectrum for 1 Chan (CDB).gvi"(signal=w32, dB on=TRUE) -> (power spectrum=w33)
          append w33 to w31
        }
        $"Baseband Power Spectrum" <- w31
      }
    }
    $"Actual Rx Timestamp" <- w23
    Logical Or(w24, $Stop) -> w34
    case ($Sync) {
      frame False, Default {
        w35 = default
      }
      frame True {
        Array Index(array=w22) -> (out0[0, _]=w36)
        Array Index(array=w22) -> (out0[1, _]=w37)
        Divide(x=w36, y=w37) -> w38
        call "Mean (CDB).gvi"(x=w38) -> (mean=w35)
      }
    }
    case ($Get) {
      frame False, Default { }
      frame True {
        Math Node("signal"=w22) -> ("out_b"=w39, "angles_o"=w40)
        ~~~
        sz = size(signal);
        %angles is a row matrix of length angles
        angles = (-sz(1)*180:sz(1)*180)/(180) * pi;
        steering_base = angles/sz(1);
        %assuming uniform and linear array
        steering = exp(j*(1:sz(1))'*steering_base)
        %steering is now a num_receivers by num angles matrix
        steered_arr = steering'*signal;
        out_b = sum(abs(steered_arr),2)';
        out_s =size(out_b)
        angles_o = exp(j*steering_base).*out_b;
        ~~~
        $Graph <- w39
        $"Polar Graph" <- w40
      }
    }
    Array Index(array=w22) -> (out0[0, _]=w41)
    Array Index(array=w22) -> (out0[1, _]=w42)
    Feedback Node(enable?=$Sync, input=w35) -> w43
    Multiply(w43, w42) -> w44
    Build Array(w41, w44) -> w45
    Complex To Polar(r * e^(i*theta)=w45) -> (r=w46, theta=w47)
    Build Array[ConcatenateInputs=True](w46, w47) -> w48
    $"Sync'd Signal" <- w48
    $"Phase Offset" <- w43
    next s1 = w24
    stop if w34
  }
  call "niUSRP Abort.gvi"(session handle=w21, error in=s1) -> (session handle out=w49, error out=w50)
  call "niUSRP Close Session.gvi"(session handle=w49, error in=w50) -> (error out=w51)
  call "Simple Error Handler.gvi"(error in=w51)
